# Grasshopper definition plot_structure.gh (Grasshopper 1.0.7)

root_path = Panel("C:\\Users\\maxime.pollet\\Documents\\Code\\corbu")
results_folder = Panel("2025-12-18_11-17-37")
structure_id = Panel("2")
python = GhPythonScript(root_path=root_path, results_folder=results_folder, sample_id=structure_id)  # -> sample_characteristics, beams, beam_ids, beam_materials, beam_heights, beam_widths, columns, column_ids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; inputs sample_id: Int32
# ---------- python: Python ----------
__author__ = "maxime.pollet"
__version__ = "2025.08.04"

import rhinoscriptsyntax as rs
import csv
import os

# __INPUTS__
# sample_id: integer (identifier of the sample to load)

def to_float(val):
    try:
        return float(val)
    except:
        return 0.0

# --- Load sample characteristics ---
sample_characteristics = []
samples_file = '{:s}\\data\\results\\{:s}\\selected_designs.csv'.format(root_path, results_folder)
with open(samples_file, 'r') as f:
    reader = csv.DictReader(f)
    for row in reader:
        if int(row['structure_id']) == sample_id:
            sample_characteristics.append('structure_id = {:s}'.format(str(row['structure_id'])))
            sample_characteristics.append('nb_floors = {:s}'.format(str(row['nb_floors'])))
            sample_characteristics.append('building_width = {:s}'.format(str(row['building_width'])))
            sample_characteristics.append('building_length = {:s}'.format(str(row['building_length'])))
            sample_characteristics.append('column_height = {:s}'.format(str(2.5)))
            sample_characteristics.append('column_spacing_x = {:s}'.format(str(row['column_spacing_x'])))
            sample_characteristics.append('column_spacing_y = {:s}'.format(str(row['column_spacing_y'])))
            sample_characteristics.append('core_length = {:s}'.format(str(row['core_length'])))
            sample_characteristics.append('core_width = {:s}'.format(str(row['core_width'])))
            sample_characteristics.append('max_stair_distance = {:s}'.format(str(row['max_stair_distance'])))
            sample_characteristics.append('core_location_y = {:s}'.format(str(row['core_location_y'])))
            sample_characteristics.append('floor_material = {:s}'.format(str(row['floor_material'])))
            sample_characteristics.append('beam_material = {:s}'.format(str(row['beam_material'])))
            sample_characteristics.append('column_material = {:s}'.format(str(row['column_material'])))
            break

# --- Load Floors ---
floors = []
floor_ids = []
floor_typologies = []
floor_thicknesses = []
floors_file = '{:s}\\data\\results\\{:s}\\designed_structure_{:d}\\floors.csv'.format(root_path, results_folder, sample_id)
with open(floors_file, 'r') as f:
    reader = csv.DictReader(f)
    for row in reader:
        p1_x = to_float(row['p1_x'])
        p1_y = to_float(row['p1_y'])
        p1_z = to_float(row['p1_z'])
        p2_x = to_float(row['p2_x'])
        p2_y = to_float(row['p2_y'])
        p2_z = to_float(row['p2_z'])
        p3_x = to_float(row['p3_x'])
        p3_y = to_float(row['p3_y'])
        p3_z = to_float(row['p3_z'])
        p4_x = to_float(row['p4_x'])
        p4_y = to_float(row['p4_y'])
        p4_z = to_float(row['p4_z'])
        floor = rs.AddSrfPt([(p1_x,p1_y,p1_z),(p3_x,p3_y,p3_z),(p4_x,p4_y,p4_z),(p2_x,p2_y,p2_z)])
        floors.append(floor)
        floor_ids.append(row['Floor id'])
        floor_typologies.append(row['Typology'])
        floor_thicknesses.append(row['Thickness (m)'])

# --- Load Beams ---
beams = []
beam_ids = []
beam_materials = []
beam_heights = []
beam_widths = []
beams_file = '{:s}\\data\\results\\{:s}\\designed_structure_{:d}\\beams.csv'.format(root_path, results_folder, sample_id)
with open(beams_file, 'r') as f:
    reader = csv.DictReader(f)
    for row in reader:
        p1_x = to_float(row['p1_x'])
        p1_y = to_float(row['p1_y'])
        p1_z = to_float(row['p1_z'])
        p2_x = to_float(row['p2_x'])
        p2_y = to_float(row['p2_y'])
        p2_z = to_float(row['p2_z'])
        beam = rs.AddLine((p1_x,p1_y,p1_z),(p2_x,p2_y,p2_z))
        beams.append(beam)
        beam_ids.append(row['Beam id'])
        beam_materials.append(row["Material type"])
        if row["Material type"] == 'Steel':
            if row["Section (mm*mm)"][:2] == 'IP' or row["Section (mm*mm)"][:2] == 'PR':
                beam_heights.append(int(row["Section (mm*mm)"][3:]))
                beam_widths.append(int(row["Section (mm*mm)"][3:])/2)
            elif row["Section (mm*mm)"][:2] == 'HE':
                beam_heights.append(int(row["Section (mm*mm)"][2:-1]))
                beam_widths.append(int(row["Section (mm*mm)"][2:-1])/2)
        else:
            beam_heights.append(int(row["Section (mm*mm)"].split('x')[0]))
            beam_widths.append(int(row["Section (mm*mm)"].split('x')[1]))

# --- Load Foundation Beams ---
found_beams = []
found_beam_ids = []
found_beam_materials = []
found_beam_heights = []
found_beam_widths = []
found_beams_file = '{:s}\\data\\results\\{:s}\\designed_structure_{:d}\\foundation_beams.csv'.format(root_path, results_folder, sample_id)
with open(found_beams_file, 'r') as f:
    reader = csv.DictReader(f)
    for row in reader:
        p1_x = to_float(row['p1_x'])
        p1_y = to_float(row['p1_y'])
        p1_z = to_float(row['p1_z'])
        p2_x = to_float(row['p2_x'])
        p2_y = to_float(row['p2_y'])
        p2_z = to_float(row['p2_z'])
        found_beam = rs.AddLine((p1_x,p1_y,p1_z),(p2_x,p2_y,p2_z))
        found_beams.append(found_beam)
        found_beam_ids.append(row['Beam id'])
        found_beam_materials.append(row["Material type"])
        if row["Material type"] == 'Steel':
            if row["Section (mm*mm)"][:2] == 'IP' or row["Section (mm*mm)"][:2] == 'PR':
                found_beam_heights.append(int(row["Section (mm*mm)"][3:]))
                found_beam_widths.append(int(row["Section (mm*mm)"][3:])/2)
            elif row["Section (mm*mm)"][:2] == 'HE':
                found_beam_heights.append(int(row["Section (mm*mm)"][2:-1]))
                found_beam_widths.append(int(row["Section (mm*mm)"][2:-1])/2)
        else:
            found_beam_heights.append(int(row["Section (mm*mm)"].split('x')[0]))
            found_beam_widths.append(int(row["Section (mm*mm)"].split('x')[1]))

# --- Load Columns ---
columns = []
column_ids = []
column_materials = []
column_widths = []
columns_file = '{:s}\\data\\results\\{:s}\\designed_structure_{:d}\\columns.csv'.format(root_path, results_folder, sample_id)
with open(columns_file, 'r') as f:
    reader = csv.DictReader(f)
    for row in reader:
        p1_x = to_float(row['p1_x'])
        p1_y = to_float(row['p1_y'])
        p1_z = to_float(row['p1_z'])
        p2_x = to_float(row['p2_x'])
        p2_y = to_float(row['p2_y'])
        p2_z = to_float(row['p2_z'])
        column = rs.AddLine((p1_x,p1_y,p1_z),(p2_x,p2_y,p2_z))
        columns.append(column)
        column_ids.append(row['Column id'])
        column_materials.append(row['Material type'])
        if row["Material type"] == 'Steel':
            if row["Section (mm*mm)"][:2] == 'IP' or row["Section (mm*mm)"][:2] == 'PR':
                column_widths.append(int(row["Section (mm*mm)"][3:]))
            elif row["Section (mm*mm)"][:2] == 'HE':
                column_widths.append(int(row["Section (mm*mm)"][2:-1]))
        else:
            column_widths.append(int(row["Section (mm*mm)"].split('x')[1]))

# --- Load Walls ---
walls = []
wall_ids = []
walls_file = '{:s}\\data\\results\\{:s}\\designed_structure_{:d}\\walls.csv'.format(root_path, results_folder, sample_id)
with open(walls_file, 'r') as f:
    reader = csv.DictReader(f)
    for row in reader:
        p1_x = to_float(row['p1_x'])
        p1_y = to_float(row['p1_y'])
        p1_z = to_float(row['p1_z'])
        p2_x = to_float(row['p2_x'])
        p2_y = to_float(row['p2_y'])
        p2_z = to_float(row['p2_z'])
        p3_x = to_float(row['p3_x'])
        p3_y = to_float(row['p3_y'])
        p3_z = to_float(row['p3_z'])
        p4_x = to_float(row['p4_x'])
        p4_y = to_float(row['p4_y'])
        p4_z = to_float(row['p4_z'])
        wall = rs.AddSrfPt([(p1_x,p1_y,p1_z),(p3_x,p3_y,p3_z),(p4_x,p4_y,p4_z),(p2_x,p2_y,p2_z)])
        walls.append(wall)
        wall_ids.append(row['Wall id'])

# --- Load foundation Floors ---
found_floors = []
found_floor_ids = []
found_floor_typologies = []
found_floor_thicknesses = []
found_floors_file = '{:s}\\data\\results\\{:s}\\designed_structure_{:d}\\foundation_floors.csv'.format(root_path, results_folder, sample_id)
with open(found_floors_file, 'r') as f:
    reader = csv.DictReader(f)
    for row in reader:
        p1_x = to_float(row['p1_x'])
        p1_y = to_float(row['p1_y'])
        p1_z = to_float(row['p1_z'])
        p2_x = to_float(row['p2_x'])
        p2_y = to_float(row['p2_y'])
        p2_z = to_float(row['p2_z'])
        p3_x = to_float(row['p3_x'])
        p3_y = to_float(row['p3_y'])
        p3_z = to_float(row['p3_z'])
        p4_x = to_float(row['p4_x'])
        p4_y = to_float(row['p4_y'])
        p4_z = to_float(row['p4_z'])
        found_floor = rs.AddSrfPt([(p1_x,p1_y,p1_z),(p3_x,p3_y,p3_z),(p4_x,p4_y,p4_z),(p2_x,p2_y,p2_z)])
        found_floors.append(found_floor)
        found_floor_ids.append(row['Floor id'])
        found_floor_typologies.append(row['Typology'])
        found_floor_thicknesses.append(row['Thickness (m)'])

continuous_footing_id = []
continuous_footings = []
continuous_footing_wall = []
continuous_footing_width = []
continuous_footing_height = []
continuous_footing_file = '{:s}\\data\\results\\{:s}\\designed_structure_{:d}\\continuous_footings.csv'.format(root_path, results_folder, sample_id)
with open(continuous_footing_file, 'r') as f:
    reader = csv.DictReader(f)
    for i, row in enumerate(reader):
        continuous_footing_id.append(row["Continuous footing id"])
        continuous_footing_wall.append(int(row["Ref. wall"].split('_')[-1]))
        continuous_footing_width.append(float(row["Width (m)"]))
        continuous_footing_height.append(float(row["Height (m)"]))
        p1_x = to_float(row['p1_x'])
        p1_y = to_float(row['p1_y'])
        p1_z = to_float(row['p1_z'])
        p2_x = to_float(row['p2_x'])
        p2_y = to_float(row['p2_y'])
        p2_z = to_float(row['p2_z'])
        cont_footing = rs.AddLine((p1_x,p1_y,p1_z),(p2_x,p2_y,p2_z))
        continuous_footings.append(cont_footing)

isolated_footing_id = []
isolated_footings = []
isolated_footing_column = []
isolated_footing_width = []
isolated_footing_height = []
isolated_footing_file = '{:s}\\data\\results\\{:s}\\designed_structure_{:d}\\isolated_footings.csv'.format(root_path, results_folder, sample_id)
with open(isolated_footing_file, 'r') as f:
    reader = csv.DictReader(f)
    for i, row in enumerate(reader):
        isolated_footing_id.append(row["Isolated footing id"])
        isolated_footing_column.append(int(row["Ref. column"].split('_')[-1]))
        isolated_footing_width.append(float(row["Width (m)"]))
        isolated_footing_height.append(float(row["Height (m)"]))
        p1_x = to_float(row['p_x'])
        p1_y = to_float(row['p_y'])
        p1_z = to_float(row['p_z'])
        isolated_footing = rs.AddPoint((p1_x,p1_y,p1_z))
        isolated_footings.append(isolated_footing)
# ---------- end python ----------
panel = Panel(python.sample_characteristics)

foundation_beams = Curve(python.found_beams)
foundation_floors = Surface(python.found_floors)
nodes = Point()
columns = Curve(python.columns)
beams = Curve(python.beams)
walls = Surface(python.walls)
floors = Surface(python.floors)

# ---- group: Generate continuous footing boxes
item = ListItem(List=walls, Index=python.continuous_footing_wall, Wrap=True)
debrep = DeconstructBrep(Brep=item)  # -> Faces, Edges, Vertices
crv = Curve(debrep.Edges)
midpt = CurveMiddle(Curve=crv)
pdecon = Deconstruct(Point=midpt)  # -> XComponent, YComponent, ZComponent
expression = Expression(z=pdecon.ZComponent, Expression="IF(z < 0.001, True, False)")
dispatch = Dispatch(List=crv, DispatchPattern=expression)  # -> flatten(ListA), ListB
crv_2 = Curve(dispatch.ListA)
midpt_2 = CurveMiddle(Curve=crv_2)
end = EndPoints(Curve=crv_2)  # -> Start, End
vec2pt = Vector2Pt(PointA=end.Start, PointB=end.End, Unitize=False)  # -> Vector, Length
pl = PlaneNormal(Origin=end.Start, ZAxis=vec2pt.Vector)
devec = DeconstructVector(Vector=vec2pt.Vector)  # -> XComponent, YComponent, ZComponent
expression_2 = Expression(x=devec.XComponent, Expression="IF(x=0, 0.5, 0)")
division = Division(A=python.continuous_footing_width, B=2)
division_2 = Division(A=python.continuous_footing_height, B=2)
multiplication = Multiplication(A=division, B=-1)
multiplication_2 = Multiplication(A=division_2, B=-1)
len = Length(Curve=crv_2)
pi = Pi(Factor=expression_2)
dom = ConstructDomain(DomainStart=multiplication, DomainEnd=division)
dom_2 = ConstructDomain(DomainStart=multiplication_2, DomainEnd=division_2)
prot = RotatePlane(Plane=pl, Angle=pi)
rectangle = Rectangle(Plane=prot, XSize=dom, YSize=dom_2, Radius=0)  # -> Rectangle, Length
Z = UnitZ(Factor=division_2)
boxrec = BoxRectangle(Rectangle=rectangle.Rectangle, Height=len)
rev = Reverse(Vector=Z)
move = Move(Geometry=boxrec, Motion=rev)  # -> Geometry, Transform

# ---- group: Generate foundation floor boxes
planesrf = PlaneSurface(Plane=foundation_floors, XSize=Domain(-10, 10), YSize=Domain(-10, 10))
deplane = DeconstructPlane(Plane=planesrf)  # -> Origin, XAxis, YAxis, ZAxis
pdecon_2 = Deconstruct(Point=deplane.ZAxis)  # -> XComponent, YComponent, ZComponent
expression_3 = Expression(x=pdecon_2.ZComponent, Expression="IF(x=-1, True, False)")
pt = Point(Point(0, 0, 100))
dispatch_2 = Dispatch(List=foundation_floors, DispatchPattern=expression_3)  # -> ListA, ListB
planesrf_2 = PlaneSurface(Plane=pt, XSize=Domain(-10, 10), YSize=Domain(-10, 10))
srf = Surface(dispatch_2.ListB)
srf_2 = Surface(dispatch_2.ListA)
Z_2 = UnitZ(Factor=python.found_floor_thicknesses)
debrep_2 = DeconstructBrep(Brep=srf_2)  # -> Faces, Edges, Vertices
flip = Flip(Surface=foundation_floors, Guide=planesrf_2)  # -> Surface, Result
dispatch_3 = Dispatch(List=Z_2, DispatchPattern=expression_3)  # -> ListA, ListB
pdecon_3 = Deconstruct(Point=debrep_2.Vertices)  # -> XComponent, YComponent, ZComponent
srf_3 = Surface(flip.Surface)
avr = Average(Input=pdecon_3.XComponent)
avr_2 = Average(Input=pdecon_3.YComponent)
avr_3 = Average(Input=pdecon_3.ZComponent)
pt_2 = ConstructPoint(XCoordinate=avr, YCoordinate=avr_2, ZCoordinate=avr_3)
Y = UnitY(Factor=1)
move_2 = Move(Geometry=pt_2, Motion=Y)  # -> Geometry, Transform
planesrf_3 = PlaneSurface(Plane=srf_3, XSize=Domain(-10, 10), YSize=Domain(-10, 10))
ln = Line(StartPoint=pt_2, EndPoint=move_2.Geometry)  # -> flatten(Line)
merge = Merge(Data1=dispatch_3.ListA, Data2=dispatch_3.ListB)
deplane_2 = DeconstructPlane(Plane=planesrf_3)  # -> Origin, XAxis, YAxis, ZAxis
rotax = RotateAxis(Geometry=srf_2, Angle=3.141592654, Axis=ln)  # -> Geometry, Transform
merge_2 = Merge(Data1=rotax.Geometry, Data2=srf)
boxrec_2 = BoxRectangle(Rectangle=merge_2, Height=merge)

# ---- group: Generate floor boxes
planesrf_4 = PlaneSurface(Plane=floors, XSize=Domain(-10, 10), YSize=Domain(-10, 10))
deplane_3 = DeconstructPlane(Plane=planesrf_4)  # -> Origin, XAxis, YAxis, ZAxis
pdecon_4 = Deconstruct(Point=deplane_3.ZAxis)  # -> XComponent, YComponent, ZComponent
expression_4 = Expression(x=pdecon_4.ZComponent, Expression="IF(x=-1, True, False)")
pt_3 = Point(Point(0, 0, 100))
dispatch_4 = Dispatch(List=floors, DispatchPattern=expression_4)  # -> ListA, ListB
planesrf_5 = PlaneSurface(Plane=pt_3, XSize=Domain(-10, 10), YSize=Domain(-10, 10))
srf_4 = Surface(dispatch_4.ListB)
srf_5 = Surface(dispatch_4.ListA)
Z_3 = UnitZ(Factor=python.floor_thicknesses)
debrep_3 = DeconstructBrep(Brep=srf_5)  # -> Faces, Edges, Vertices
flip_2 = Flip(Surface=floors, Guide=planesrf_5)  # -> Surface, Result
dispatch_5 = Dispatch(List=Z_3, DispatchPattern=expression_4)  # -> ListA, ListB
pdecon_5 = Deconstruct(Point=debrep_3.Vertices)  # -> XComponent, YComponent, ZComponent
srf_6 = Surface(flip_2.Surface)
avr_4 = Average(Input=pdecon_5.XComponent)
avr_5 = Average(Input=pdecon_5.YComponent)
avr_6 = Average(Input=pdecon_5.ZComponent)
pt_4 = ConstructPoint(XCoordinate=avr_4, YCoordinate=avr_5, ZCoordinate=avr_6)
Y_2 = UnitY(Factor=1)
move_3 = Move(Geometry=pt_4, Motion=Y_2)  # -> Geometry, Transform
planesrf_6 = PlaneSurface(Plane=srf_6, XSize=Domain(-10, 10), YSize=Domain(-10, 10))
ln_2 = Line(StartPoint=pt_4, EndPoint=move_3.Geometry)  # -> flatten(Line)
merge_3 = Merge(Data1=dispatch_5.ListA, Data2=dispatch_5.ListB)
deplane_4 = DeconstructPlane(Plane=planesrf_6)  # -> Origin, XAxis, YAxis, ZAxis
rotax_2 = RotateAxis(Geometry=srf_5, Angle=3.141592654, Axis=ln_2)  # -> Geometry, Transform
merge_4 = Merge(Data1=rotax_2.Geometry, Data2=srf_4)
boxrec_3 = BoxRectangle(Rectangle=merge_4, Height=merge_3)

# ---- group: Generate foundation beams
end_2 = EndPoints(Curve=foundation_beams)  # -> Start, End
vec2pt_2 = Vector2Pt(PointA=end_2.Start, PointB=end_2.End, Unitize=False)  # -> Vector, Length
pl_2 = PlaneNormal(Origin=end_2.Start, ZAxis=vec2pt_2.Vector)
multiplication_3 = Multiplication(A=python.found_beam_heights, B=0.001)
devec_2 = DeconstructVector(Vector=vec2pt_2.Vector)  # -> XComponent, YComponent, ZComponent
multiplication_4 = Multiplication(A=python.found_beam_widths, B=0.001)
expression_5 = Expression(x=devec_2.XComponent, Expression="IF(x=0, 0.5, 0)")
division_3 = Division(A=multiplication_4, B=2)
division_4 = Division(A=multiplication_3, B=2)
multiplication_5 = Multiplication(A=division_3, B=-1)
multiplication_6 = Multiplication(A=division_4, B=-1)
len_2 = Length(Curve=foundation_beams)
pi_2 = Pi(Factor=expression_5)
dom_3 = ConstructDomain(DomainStart=multiplication_5, DomainEnd=division_3)
dom_4 = ConstructDomain(DomainStart=multiplication_6, DomainEnd=division_4)
prot_2 = RotatePlane(Plane=pl_2, Angle=pi_2)
rectangle_2 = Rectangle(Plane=prot_2, XSize=dom_3, YSize=dom_4, Radius=0)  # -> Rectangle, Length
Z_4 = UnitZ(Factor=division_4)
boxrec_4 = BoxRectangle(Rectangle=rectangle_2.Rectangle, Height=len_2)
rev_2 = Reverse(Vector=Z_4)
move_4 = Move(Geometry=boxrec_4, Motion=rev_2)  # -> Geometry, Transform

# ---- group: Generate column boxes
end_3 = EndPoints(Curve=columns)  # -> Start, End
vec2pt_3 = Vector2Pt(PointA=end_3.Start, PointB=end_3.End, Unitize=False)  # -> Vector, Length
pl_3 = PlaneNormal(Origin=end_3.Start, ZAxis=vec2pt_3.Vector)
multiplication_7 = Multiplication(A=python.column_widths, B=0.001)
len_3 = Length(Curve=columns)
division_5 = Division(A=multiplication_7, B=2)
multiplication_8 = Multiplication(A=division_5, B=-1)
dom_5 = ConstructDomain(DomainStart=multiplication_8, DomainEnd=division_5)
rectangle_3 = Rectangle(Plane=pl_3, XSize=dom_5, YSize=dom_5, Radius=0)  # -> Rectangle, Length
boxrec_5 = BoxRectangle(Rectangle=rectangle_3.Rectangle, Height=len_3)

# ---- group: Generate beam boxes
end_4 = EndPoints(Curve=beams)  # -> Start, End
vec2pt_4 = Vector2Pt(PointA=end_4.Start, PointB=end_4.End, Unitize=False)  # -> Vector, Length
pl_4 = PlaneNormal(Origin=end_4.Start, ZAxis=vec2pt_4.Vector)
multiplication_9 = Multiplication(A=python.beam_heights, B=0.001)
devec_3 = DeconstructVector(Vector=vec2pt_4.Vector)  # -> XComponent, YComponent, ZComponent
multiplication_10 = Multiplication(A=python.beam_widths, B=0.001)
expression_6 = Expression(x=devec_3.XComponent, Expression="IF(x=0, 0.5, 0)")
division_6 = Division(A=multiplication_10, B=2)
division_7 = Division(A=multiplication_9, B=2)
multiplication_11 = Multiplication(A=division_6, B=-1)
multiplication_12 = Multiplication(A=division_7, B=-1)
len_4 = Length(Curve=beams)
pi_3 = Pi(Factor=expression_6)
dom_6 = ConstructDomain(DomainStart=multiplication_11, DomainEnd=division_6)
dom_7 = ConstructDomain(DomainStart=multiplication_12, DomainEnd=division_7)
prot_3 = RotatePlane(Plane=pl_4, Angle=pi_3)
rectangle_4 = Rectangle(Plane=prot_3, XSize=dom_6, YSize=dom_7, Radius=0)  # -> Rectangle, Length
Z_5 = UnitZ(Factor=division_7)
boxrec_6 = BoxRectangle(Rectangle=rectangle_4.Rectangle, Height=len_4)
rev_3 = Reverse(Vector=Z_5)
move_5 = Move(Geometry=boxrec_6, Motion=rev_3)  # -> Geometry, Transform

# ---- group: Generate isolated footing boxes
multiplication_13 = Multiplication(A=python.found_beam_heights, B=0.001)
sort = SortList(Keys=multiplication_13)  # -> reverse(Keys), ValuesA
item_2 = ListItem(List=sort.Keys, Index=0, Wrap=True)
division_8 = Division(A=python.isolated_footing_height, B=2)
box = CenterBox(
    Base=python.isolated_footings,
    X=python.isolated_footing_width,
    Y=python.isolated_footing_width,
    Z=python.isolated_footing_height)
addition = Addition(A=division_8, B=item_2)
Z_6 = UnitZ(Factor=addition)
rev_4 = Reverse(Vector=Z_6)
move_6 = Move(Geometry=box, Motion=rev_4)  # -> Geometry, Transform

# ----
steel = ColourSwatch(SwatchColor=RGB(85, 84, 171))
timber = ColourSwatch(SwatchColor=RGB(255, 178, 0))
collaborant = ColourSwatch(SwatchColor=RGB(124, 123, 189))
concrete = ColourSwatch(SwatchColor=RGB(112, 112, 112))
clt = ColourSwatch(SwatchColor=RGB(255, 178, 0))

# ---- group: Generate walls
boxrec_7 = BoxRectangle(Rectangle=walls, Height=Slider(0.2, range=0..1))

# ----
merge_5 = Merge(Data1=concrete, Data2=collaborant, Data3=clt)
geo = Geometry(move_6.Geometry)
geo_2 = Geometry(move.Geometry)
collaborant_2 = ColourSwatch(SwatchColor=RGB(124, 123, 189))
concrete_2 = ColourSwatch(SwatchColor=RGB(171, 171, 171))
clt_2 = ColourSwatch(SwatchColor=RGB(255, 178, 0))
python_2 = GhPythonScript(material=python.floor_typologies)  # -> mat_ind
# ---------- python_2: Python ----------
__author__ = "maxime.pollet"
__version__ = "2025.09.13"

import rhinoscriptsyntax as rs

if material == 'Coulee-En-Place':
    mat_ind = 0
elif material == 'Collaborant':
    mat_ind = 1
elif material == 'CLT':
    mat_ind = 2
else:
    raise
# ---------- end python_2 ----------
geo_3 = Geometry(move_4.Geometry)
python_3 = GhPythonScript(material=python.column_materials)  # -> mat_ind
# ---------- python_3: Python ----------
__author__ = "maxime.pollet"
__version__ = "2025.09.13"

import rhinoscriptsyntax as rs

if material == 'Timber':
    mat_ind = 0
elif material == 'Concrete':
    mat_ind = 1
elif material == 'Steel':
    mat_ind = 2
else:
    raise
# ---------- end python_3 ----------
merge_6 = Merge(Data1=concrete_2, Data2=collaborant_2, Data3=clt_2)
concrete_3 = ColourSwatch(SwatchColor=RGB(171, 171, 171))
timber_2 = ColourSwatch(SwatchColor=RGB(255, 178, 0))
steel_2 = ColourSwatch(SwatchColor=RGB(85, 84, 171))
geo_4 = Geometry(boxrec_2)
item_3 = ListItem(List=merge_6, Index=python_2, Wrap=True)
geo_5 = Geometry(boxrec_7)
concrete_4 = ColourSwatch(SwatchColor=RGB(171, 171, 171))
geo_6 = Geometry(boxrec_3)
geo_7 = Geometry(move_5.Geometry)
timber_3 = ColourSwatch(SwatchColor=RGB(255, 178, 0))
steel_3 = ColourSwatch(SwatchColor=RGB(85, 84, 171))
concrete_5 = ColourSwatch(SwatchColor=RGB(171, 171, 171))
geo_8 = Geometry(boxrec_5)
merge_7 = Merge(Data1=timber_2, Data2=concrete_3, Data3=steel_2)
concrete_6 = ColourSwatch(SwatchColor=RGB(171, 171, 171))
concrete_7 = ColourSwatch(SwatchColor=RGB(171, 171, 171))
concrete_8 = ColourSwatch(SwatchColor=RGB(171, 171, 171))
python_4 = GhPythonScript(material=python.beam_materials)  # -> mat_ind; same code as python_3
merge_8 = Merge(Data1=timber_3, Data2=concrete_4, Data3=steel_3)
item_4 = ListItem(List=merge_7, Index=python_3, Wrap=True)
material = CreateMaterial(Diffuse=concrete_5, Specular=RGB(255, 255, 255), Emission=RGB(0, 0, 0), Transparency=0, Shine=0)
item_5 = ListItem(List=merge_8, Index=python_4, Wrap=True)
material_2 = CreateMaterial(Diffuse=concrete_7, Specular=RGB(255, 255, 255), Emission=RGB(0, 0, 0), Transparency=0, Shine=0)
concrete_9 = ColourSwatch(SwatchColor=RGB(171, 171, 171))
material_3 = CreateMaterial(Diffuse=concrete_8, Specular=RGB(255, 255, 255), Emission=RGB(0, 0, 0), Transparency=0, Shine=0)
material_4 = CreateMaterial(Diffuse=concrete_6, Specular=RGB(255, 255, 255), Emission=RGB(0, 0, 0), Transparency=0, Shine=0)
material_5 = CreateMaterial(Diffuse=concrete_9, Specular=RGB(255, 255, 255), Emission=RGB(0, 0, 0), Transparency=0, Shine=0)
material_6 = CreateMaterial(Diffuse=item_3, Specular=RGB(255, 255, 255), Emission=RGB(0, 0, 0), Transparency=0, Shine=0)
material_7 = CreateMaterial(Diffuse=item_4, Specular=RGB(255, 255, 255), Emission=RGB(0, 0, 0), Transparency=0, Shine=0)
material_8 = CreateMaterial(Diffuse=item_5, Specular=RGB(255, 255, 255), Emission=RGB(0, 0, 0), Transparency=0, Shine=0)
preview = CustomPreview(Geometry=geo_7, Material=material_8)
preview_2 = CustomPreview(Geometry=geo, Material=material)
preview_3 = CustomPreview(Geometry=geo_8, Material=material_7)
preview_4 = CustomPreview(Geometry=geo_3, Material=material_3)
preview_5 = CustomPreview(Geometry=geo_6, Material=material_6)
preview_6 = CustomPreview(Geometry=geo_2, Material=material_2)
preview_7 = CustomPreview(Geometry=geo_5, Material=material_5)
preview_8 = CustomPreview(Geometry=geo_4, Material=material_4)
